# Grasshopper definition childcare.gh (Grasshopper 1.0.7)
# Copyright: Co-de-iT
# plug-ins: Bifocals

# ---- group: Roof
Y = UnitY(Factor=1)
pt = Point(<point referenced from the Rhino model>)
line = LineSDL(Start=pt, Direction=Y, Length=Slider(50, range=0..100))
number_slider = Slider(10, range=0..20)
X = UnitX(Factor=Slider(5, range=0..10))
arrlinear = LinearArray(Geometry=line, Direction=X, Count=number_slider)  # -> Geometry, Transform
range = Range(Domain=Domain(0, 1), Steps=expr("x-1", number_slider))
curvepoint = PointOnCurve(arrlinear.Geometry, parameter=0.5)
X_2 = UnitX(Factor=1)
graph = GraphMapper(
    range,
    x0=0,
    x1=1,
    y0=0,
    y1=1,
    Ox=0.5101451278,
    Oy=0.02237725258,
    Px=0.7304347157,
    Py=0.4027961493,
    container_name="Parabola")
number_slider_2 = Slider(13, range=0..100)
remap = Remap(data=graph, min=expr("-x", number_slider_2), max=number_slider_2)
rot3d = Rotate3D(Geometry=arrlinear.Geometry, Angle=degrees(remap), Center=curvepoint, Axis=X_2)  # -> Geometry, Transform
Z = UnitZ(Factor=Slider(0, range=0..300))
move = Move(Geometry=rot3d.Geometry, Motion=Z)  # -> Geometry, Transform
Z_2 = UnitZ(Factor=Slider(165, range=0..200))
extr = Extrude(Base=move.Geometry, Direction=Z_2)
X_3 = UnitX(Factor=Slider(7, range=0..10))
extr_2 = Extrude(Base=extr, Direction=X_3)

# ----
X_4 = UnitX(Factor=1)
pt_2 = Point(<point referenced from the Rhino model>)

# ---- group: Column
pt_3 = Point(<point referenced from the Rhino model>)
pt_4 = Point(<point referenced from the Rhino model>)
cir = Circle(Plane=[pt_3, pt_4], Radius=Slider(2, range=0..100))
divide = DivideCurve(Curve=cir, Count=Slider(15, range=0..100), Kinks=False)  # -> Points, Tangents, Parameters
bang = ExplodeTree(Data=divide.Points)  # -> Branch0, Branch1
neg = Negative(Value=Slider(5, range=0..10))
shift = ShiftList(List=bang.Branch1, Shift=Slider(5, range=0..10), Wrap=True)
shift_2 = ShiftList(List=bang.Branch1, Shift=neg, Wrap=True)
ln = Line(StartPoint=bang.Branch0, EndPoint=shift)
ln_2 = Line(StartPoint=bang.Branch0, EndPoint=shift_2)
pipe = Pipe(Curve=[ln, ln_2, cir], Radius=Slider(3, range=0..10), Caps=0)

# ----
number_slider_3 = Slider(640, range=0..1000)
line_2 = LineSDL(Start=pt_2, Direction=X_4, Length=Slider(624, range=0..1000))
Y_2 = UnitY(Factor=1)
range_2 = Range(Domain=Domain(0, 1), Steps=expr("x-1", number_slider_3))
arrlinear_2 = LinearArray(Geometry=line_2, Direction=Y_2, Count=number_slider_3)  # -> Geometry, Transform
graph_2 = GraphMapper(range_2, x0=0, x1=1, y0=0, y1=1, container_name="Sine", Equation_px=[0, 0.5168979168], Equation_py=[0, 0.5762815475])
number_slider_4 = Slider(30, range=0..100)
remap_2 = Remap(data=graph_2, min=expr("-x", number_slider_4), max=number_slider_4)
xy = XYPlane(Origin=Point(0, 0, 0))
neg_2 = Negative(Value=Slider(10, range=0..50))
rotate = Rotate(Geometry=arrlinear_2.Geometry, Angle=degrees(remap_2), Plane=xy)  # -> Geometry, Transform
X_5 = UnitX(Factor=neg_2)
Y_3 = UnitY(Factor=Slider(10, range=0..30))
X_6 = UnitX(Factor=Slider(10, range=0..30))

# ---- group: Walls
brep = Brep(<brep referenced from the Rhino model>)
brep_2 = Brep(<brep referenced from the Rhino model>)
brep_3 = Brep(<brep referenced from the Rhino model>)
divide_2 = DivideDomain²(Domain=brep, UCount=Slider(5, range=0..10), VCount=Slider(2, range=0..10))
divide_3 = DivideDomain²(Domain=brep_2, UCount=Slider(5, range=0..10), VCount=Slider(2, range=0..10))
divide_4 = DivideDomain²(Domain=brep_3, UCount=Slider(5, range=0..10), VCount=Slider(2, range=0..10))
subsrf = Isotrim(Surface=brep, Domain=divide_2)
subsrf_2 = Isotrim(Surface=brep_2, Domain=divide_3)
subsrf_3 = Isotrim(Surface=brep_3, Domain=divide_4)
debrep = DeconstructBrep(Brep=subsrf)  # -> Faces, Edges, Vertices
debrep_2 = DeconstructBrep(Brep=subsrf_2)  # -> Faces, Edges, Vertices
debrep_3 = DeconstructBrep(Brep=subsrf_3)  # -> Faces, Edges, Vertices
item = ListItem(List=debrep.Edges, Index=Slider(1, range=0..3), Wrap=True)
item_2 = ListItem(List=debrep.Edges, Index=Slider(3, range=0..3), Wrap=True)
item_3 = ListItem(List=debrep_2.Edges, Index=Slider(1, range=0..3), Wrap=True)
item_4 = ListItem(List=debrep_2.Edges, Index=Slider(3, range=0..3), Wrap=True)
item_5 = ListItem(List=debrep_3.Edges, Index=Slider(1, range=0..3), Wrap=True)
item_6 = ListItem(List=debrep_3.Edges, Index=Slider(3, range=0..3), Wrap=True)
flip = FlipCurve(Curve=item_2)  # -> Curve, Flag
flip_2 = FlipCurve(Curve=item_4)  # -> Curve, Flag
flip_3 = FlipCurve(Curve=item_6)  # -> Curve, Flag
rulesrf = RuledSurface(CurveA=item, CurveB=flip.Curve)
rulesrf_2 = RuledSurface(CurveA=item_5, CurveB=flip_3.Curve)
rulesrf_3 = RuledSurface(CurveA=item_3, CurveB=flip_2.Curve)
debrep_4 = DeconstructBrep(Brep=rulesrf)  # -> Faces, Edges, Vertices
debrep_5 = DeconstructBrep(Brep=rulesrf_2)  # -> Faces, Edges, Vertices
debrep_6 = DeconstructBrep(Brep=rulesrf_3)  # -> Faces, Edges, Vertices
extr_3 = Extrude(Base=rulesrf, Direction=X_5)
area = Area(Geometry=debrep_4.Faces)  # -> Area, Centroid
area_2 = Area(Geometry=debrep_5.Faces)  # -> Area, Centroid
extr_4 = Extrude(Base=rulesrf_2, Direction=Y_3)
area_3 = Area(Geometry=debrep_6.Faces)  # -> Area, Centroid
extr_5 = Extrude(Base=rulesrf_3, Direction=X_6)
srf_cp = SurfaceClosestPoint(Point=area.Centroid, Surface=debrep_4.Faces)  # -> Point, UVPoint, Distance
srf_cp_2 = SurfaceClosestPoint(Point=area_2.Centroid, Surface=debrep_5.Faces)  # -> Point, UVPoint, Distance
srf_cp_3 = SurfaceClosestPoint(Point=area_3.Centroid, Surface=debrep_6.Faces)  # -> Point, UVPoint, Distance
evalsrf = EvaluateSurface(Surface=debrep_4.Faces, Point=srf_cp.UVPoint)  # -> Point, Normal, UDirection, VDirection, Frame
evalsrf_2 = EvaluateSurface(Surface=debrep_5.Faces, Point=srf_cp_2.UVPoint)  # -> Point, Normal, UDirection, VDirection, Frame
evalsrf_3 = EvaluateSurface(Surface=debrep_6.Faces, Point=srf_cp_3.UVPoint)  # -> Point, Normal, UDirection, VDirection, Frame
polygon = Polygon(Plane=evalsrf.Frame, Radius=Slider(7, range=0..100), Segments=Slider(4, range=0..10), FilletRadius=0)  # -> Polygon, Length
polygon_2 = Polygon(Plane=evalsrf_2.Frame, Radius=Slider(7, range=0..100), Segments=Slider(4, range=0..10), FilletRadius=0)  # -> Polygon, Length
polygon_3 = Polygon(Plane=evalsrf_3.Frame, Radius=Slider(7, range=0..100), Segments=Slider(4, range=0..10), FilletRadius=0)  # -> Polygon, Length

# ---- group: Column
pt_5 = Point(<point referenced from the Rhino model>)
pt_6 = Point(<point referenced from the Rhino model>)
cir_2 = Circle(Plane=[pt_6, pt_5], Radius=Slider(2, range=0..100))
divide_5 = DivideCurve(Curve=cir_2, Count=Slider(15, range=0..100), Kinks=False)  # -> Points, Tangents, Parameters
bang_2 = ExplodeTree(Data=divide_5.Points)  # -> Branch0, Branch1
neg_3 = Negative(Value=Slider(5, range=0..10))
shift_3 = ShiftList(List=bang_2.Branch1, Shift=Slider(5, range=0..10), Wrap=True)
shift_4 = ShiftList(List=bang_2.Branch1, Shift=neg_3, Wrap=True)
ln_3 = Line(StartPoint=bang_2.Branch0, EndPoint=shift_3)
ln_4 = Line(StartPoint=bang_2.Branch0, EndPoint=shift_4)
pipe_2 = Pipe(Curve=[ln_3, ln_4, cir_2], Radius=Slider(5, range=0..10), Caps=0)

# ---- group: Sweep
crv = Curve(reparameterize(<curve referenced from the Rhino model>))
pframe = PerpFrame(Curve=crv, Parameter=Slider(1, range=0..1))
crv_2 = Curve(<curve referenced from the Rhino model>)
pt_7 = Point(<point referenced from the Rhino model>)
orient = Orient(Geometry=crv_2, Source=pt_7, Target=pframe)  # -> Geometry, Transform
swp1 = Sweep1(Rail=crv, Sections=orient.Geometry, Miter=1)

# ---- group: Big Column
pt_8 = Point(<point referenced from the Rhino model>)
pt_9 = Point(<point referenced from the Rhino model>)
cir_3 = Circle(Plane=[pt_8, pt_9], Radius=[Slider(3, range=0..20), Slider(2, range=0..20)])
divide_6 = DivideCurve(Curve=cir_3, Count=Slider(15, range=0..100), Kinks=False)  # -> Points, Tangents, Parameters
bang_3 = ExplodeTree(Data=divide_6.Points)  # -> Branch0, Branch1
neg_4 = Negative(Value=Slider(5, range=0..10))
shift_5 = ShiftList(List=bang_3.Branch1, Shift=Slider(5, range=0..10), Wrap=True)
shift_6 = ShiftList(List=bang_3.Branch1, Shift=neg_4, Wrap=True)
ln_5 = Line(StartPoint=bang_3.Branch0, EndPoint=shift_5)
ln_6 = Line(StartPoint=bang_3.Branch0, EndPoint=shift_6)
divide_7 = DivideCurve(Curve=ln_5, Count=10, Kinks=False)  # -> Points, Tangents, Parameters
flip_4 = FlipMatrix(Data=divide_7.Points)
intcrv = Interpolate(Vertices=flip_4, Degree=3, Periodic=Toggle(True), KnotStyle=1)  # -> Curve, Length, Domain
boundary = BoundarySurfaces(Edges=intcrv.Curve)
pipe_3 = Pipe(Curve=[intcrv.Curve, ln_5, ln_6], Radius=Slider(5, range=0..10), Caps=0)
join = BrepJoin(Breps=[boundary, pipe_3])  # -> Breps, Closed

pt_10 = Point(<point referenced from the Rhino model>)
pt_11 = Point(<point referenced from the Rhino model>)
cir_4 = Circle(Plane=[pt_10, pt_11], Radius=[Slider(6, range=0..20), Slider(1, range=0..10)])
divide_8 = DivideCurve(Curve=cir_4, Count=Slider(15, range=0..100), Kinks=False)  # -> Points, Tangents, Parameters
bang_4 = ExplodeTree(Data=divide_8.Points)  # -> Branch0, Branch1
neg_5 = Negative(Value=Slider(5, range=0..10))
shift_7 = ShiftList(List=bang_4.Branch1, Shift=Slider(5, range=0..10), Wrap=True)
shift_8 = ShiftList(List=bang_4.Branch1, Shift=neg_5, Wrap=True)
ln_7 = Line(StartPoint=bang_4.Branch0, EndPoint=shift_7)
ln_8 = Line(StartPoint=bang_4.Branch0, EndPoint=shift_8)
divide_9 = DivideCurve(Curve=ln_7, Count=10, Kinks=False)  # -> Points, Tangents, Parameters
flip_5 = FlipMatrix(Data=divide_9.Points)
intcrv_2 = Interpolate(Vertices=flip_5, Degree=3, Periodic=Toggle(True), KnotStyle=1)  # -> Curve, Length, Domain
boundary_2 = BoundarySurfaces(Edges=intcrv_2.Curve)
pipe_4 = Pipe(Curve=[intcrv_2.Curve, ln_7, ln_8], Radius=Slider(5, range=0..10), Caps=0)
join_2 = BrepJoin(Breps=[boundary_2, pipe_4])  # -> Breps, Closed

# ---- group: Column
pt_12 = Point(<point referenced from the Rhino model>)
pt_13 = Point(<point referenced from the Rhino model>)
cir_5 = Circle(Plane=[pt_12, pt_13], Radius=Slider(2, range=0..100))
divide_10 = DivideCurve(Curve=cir_5, Count=Slider(15, range=0..100), Kinks=False)  # -> Points, Tangents, Parameters
bang_5 = ExplodeTree(Data=divide_10.Points)  # -> Branch0, Branch1
neg_6 = Negative(Value=Slider(5, range=0..10))
shift_9 = ShiftList(List=bang_5.Branch1, Shift=Slider(5, range=0..10), Wrap=True)
shift_10 = ShiftList(List=bang_5.Branch1, Shift=neg_6, Wrap=True)
ln_9 = Line(StartPoint=bang_5.Branch0, EndPoint=shift_9)
ln_10 = Line(StartPoint=bang_5.Branch0, EndPoint=shift_10)
pipe_5 = Pipe(Curve=[ln_9, ln_10, cir_5], Radius=Slider(3, range=0..10), Caps=0)

# ---- group: Big Column
pt_14 = Point(<point referenced from the Rhino model>)
pt_15 = Point(<point referenced from the Rhino model>)
cir_6 = Circle(Plane=[pt_14, pt_15], Radius=[Slider(3, range=0..100), Slider(2, range=0..100)])
divide_11 = DivideCurve(Curve=cir_6, Count=Slider(15, range=0..100), Kinks=False)  # -> Points, Tangents, Parameters
bang_6 = ExplodeTree(Data=divide_11.Points)  # -> Branch0, Branch1
neg_7 = Negative(Value=Slider(5, range=0..10))
shift_11 = ShiftList(List=bang_6.Branch1, Shift=Slider(5, range=0..10), Wrap=True)
shift_12 = ShiftList(List=bang_6.Branch1, Shift=neg_7, Wrap=True)
ln_11 = Line(StartPoint=bang_6.Branch0, EndPoint=shift_11)
ln_12 = Line(StartPoint=bang_6.Branch0, EndPoint=shift_12)
divide_12 = DivideCurve(Curve=ln_11, Count=10, Kinks=False)  # -> Points, Tangents, Parameters
flip_6 = FlipMatrix(Data=divide_12.Points)
intcrv_3 = Interpolate(Vertices=flip_6, Degree=3, Periodic=Toggle(True), KnotStyle=1)  # -> Curve, Length, Domain
boundary_3 = BoundarySurfaces(Edges=intcrv_3.Curve)
pipe_6 = Pipe(Curve=[intcrv_3.Curve, ln_11, ln_12], Radius=Slider(5, range=0..10), Caps=0)
join_3 = BrepJoin(Breps=[boundary_3, pipe_6])  # -> Breps, Closed

pt_16 = Point(<point referenced from the Rhino model>)
pt_17 = Point(<point referenced from the Rhino model>)
cir_7 = Circle(Plane=[pt_16, pt_17], Radius=[Slider(4, range=0..100), Slider(1, range=0..100)])
divide_13 = DivideCurve(Curve=cir_7, Count=Slider(15, range=0..100), Kinks=False)  # -> Points, Tangents, Parameters
bang_7 = ExplodeTree(Data=divide_13.Points)  # -> Branch0, Branch1
neg_8 = Negative(Value=Slider(5, range=0..10))
shift_13 = ShiftList(List=bang_7.Branch1, Shift=Slider(5, range=0..10), Wrap=True)
shift_14 = ShiftList(List=bang_7.Branch1, Shift=neg_8, Wrap=True)
ln_13 = Line(StartPoint=bang_7.Branch0, EndPoint=shift_13)
ln_14 = Line(StartPoint=bang_7.Branch0, EndPoint=shift_14)
divide_14 = DivideCurve(Curve=ln_13, Count=10, Kinks=False)  # -> Points, Tangents, Parameters
flip_7 = FlipMatrix(Data=divide_14.Points)
intcrv_4 = Interpolate(Vertices=flip_7, Degree=3, Periodic=Toggle(True), KnotStyle=1)  # -> Curve, Length, Domain
boundary_4 = BoundarySurfaces(Edges=intcrv_4.Curve)
pipe_7 = Pipe(Curve=[intcrv_4.Curve, ln_13, ln_14], Radius=Slider(5, range=0..10), Caps=0)
join_4 = BrepJoin(Breps=[boundary_4, pipe_7])  # -> Breps, Closed

# ---- group: Column
pt_18 = Point(<point referenced from the Rhino model>)
pt_19 = Point(<point referenced from the Rhino model>)
cir_8 = Circle(Plane=[pt_18, pt_19], Radius=Slider(2, range=0..100))
divide_15 = DivideCurve(Curve=cir_8, Count=Slider(15, range=0..100), Kinks=False)  # -> Points, Tangents, Parameters
bang_8 = ExplodeTree(Data=divide_15.Points)  # -> Branch0, Branch1
neg_9 = Negative(Value=Slider(5, range=0..10))
shift_15 = ShiftList(List=bang_8.Branch1, Shift=Slider(5, range=0..10), Wrap=True)
shift_16 = ShiftList(List=bang_8.Branch1, Shift=neg_9, Wrap=True)
ln_15 = Line(StartPoint=bang_8.Branch0, EndPoint=shift_15)
ln_16 = Line(StartPoint=bang_8.Branch0, EndPoint=shift_16)
pipe_8 = Pipe(Curve=[ln_15, ln_16, cir_8], Radius=Slider(2, range=0..10), Caps=0)

# ---- group: Big Column
pt_20 = Point(<point referenced from the Rhino model>)
pt_21 = Point(<point referenced from the Rhino model>)
cir_9 = Circle(Plane=[pt_20, pt_21], Radius=[Slider(4, range=0..100), Slider(1, range=0..30)])
divide_16 = DivideCurve(Curve=cir_9, Count=Slider(15, range=0..100), Kinks=False)  # -> Points, Tangents, Parameters
bang_9 = ExplodeTree(Data=divide_16.Points)  # -> Branch0, Branch1
neg_10 = Negative(Value=Slider(5, range=0..10))
shift_17 = ShiftList(List=bang_9.Branch1, Shift=Slider(5, range=0..10), Wrap=True)
shift_18 = ShiftList(List=bang_9.Branch1, Shift=neg_10, Wrap=True)
ln_17 = Line(StartPoint=bang_9.Branch0, EndPoint=shift_17)
ln_18 = Line(StartPoint=bang_9.Branch0, EndPoint=shift_18)
divide_17 = DivideCurve(Curve=ln_17, Count=10, Kinks=False)  # -> Points, Tangents, Parameters
flip_8 = FlipMatrix(Data=divide_17.Points)
intcrv_5 = Interpolate(Vertices=flip_8, Degree=3, Periodic=Toggle(True), KnotStyle=1)  # -> Curve, Length, Domain
boundary_5 = BoundarySurfaces(Edges=intcrv_5.Curve)
pipe_9 = Pipe(Curve=[intcrv_5.Curve, ln_17, ln_18], Radius=Slider(5, range=0..10), Caps=0)
join_5 = BrepJoin(Breps=[boundary_5, pipe_9])  # -> Breps, Closed

# ---- group: Column
pt_22 = Point(<point referenced from the Rhino model>)
pt_23 = Point(<point referenced from the Rhino model>)
cir_10 = Circle(Plane=[pt_22, pt_23], Radius=Slider(2, range=0..100))
divide_18 = DivideCurve(Curve=cir_10, Count=Slider(15, range=0..100), Kinks=False)  # -> Points, Tangents, Parameters
bang_10 = ExplodeTree(Data=divide_18.Points)  # -> Branch0, Branch1
neg_11 = Negative(Value=Slider(5, range=0..10))
shift_19 = ShiftList(List=bang_10.Branch1, Shift=Slider(5, range=0..10), Wrap=True)
shift_20 = ShiftList(List=bang_10.Branch1, Shift=neg_11, Wrap=True)
ln_19 = Line(StartPoint=bang_10.Branch0, EndPoint=shift_19)
ln_20 = Line(StartPoint=bang_10.Branch0, EndPoint=shift_20)
pipe_10 = Pipe(Curve=[ln_19, ln_20, cir_10], Radius=Slider(2, range=0..10), Caps=0)

# ----
panel = Panel("""{
  "type": "FeatureCollection",
  "features": [
    {
      "type": "Feature",
      "properties": {},
      "geometry": {
        "type": "Polygon",
        "coordinates": [
          [
            [
              151.23037934303284,
              -33.92008186685083
            ],
            [
              151.23020768165588,
              -33.92123034196184
            ],
            [
              151.2321388721466,
              -33.92147962133644
            ],
            [
              151.23238563537598,
              -33.92034005252707
            ],
            [
              151.23037934303284,
              -33.92008186685083
            ]
          ]
        ]
      }
    }
  ]
}""")

# ---- group: GeoJSON to Polyline 1.1
jsonpoly_1_1 = GeoJSONToPolyline11(J=panel)  # -> doc_2, P_2, K_3, V_3

# ---- group: Extrusions
brep_4 = Brep([swp1, extr_2])

# ----
crv_3 = Curve(jsonpoly_1_1.P_2)
panel_2 = Panel(brep_4)
deextrusion_1_1 = DeconstructExtrusion11(brep=brep_4)  # -> doc_2, G, bh_3, bh_4
panel_3 = Panel("""height
base_height
colour""")
entwine = Entwine(Branch00=deextrusion_1_1.bh_3, Branch01=deextrusion_1_1.bh_4, Branch02="#1523ed", FlattenInputs=True)
clean = CleanTree(RemoveNulls=True, RemoveInvalid=True, RemoveEmpty=False, Tree=deextrusion_1_1.G)
polyjson_1_1 = PolygonToGeoJSON11(P=clean, K=panel_3, V=entwine)  # -> doc_2, J_2
panel_4 = Panel(clean)
file_write = FileWrite(content=polyjson_1_1.J_2, file_path="C:\Users\Luke Lim\Documents\GitHub\as3", T="as3.geojson", activate=Toggle(True))

# ==== cluster Remap: Remaps numbers
data = ClusterInput()
min = ClusterInput()
max = ClusterInput()
bnd = Bounds(Numbers=data)
dom = ConstructDomain(DomainStart=min, DomainEnd=max)
remap = RemapNumbers(Value=data, Source=bnd, Target=dom)  # -> Mapped, Clipped
R = ClusterOutput(remap.Mapped)

# ==== cluster GeoJSONToPolyline11: Converts GeoJSON into Grasshopper geometry.
J = ClusterInput()
J_2 = Text(J)
rep = ReplaceText(Text=J_2, Find=" ", RecursiveReplace=False)
python = PythonScript(json_string=rep)  # -> doc, polylines, key, value, xyzList, coordList
# ---------- python: Python ----------
doc = """Split featureJSON into features
more exlantion here
HELLO!!!
"""
import json
import rhinoscriptsyntax as rs
import Rhino.Geometry as rg
appendPolyline = []

def main():
    raw_json = json.loads(json_string)
    features_list = raw_json["features"]
    propertieslist = [] 
    valuelist = []
    coordList =[]
    
    for item in features_list:
        coordinates = item['geometry']['coordinates']
        coordList.append(str(coordinates))
        try:#properties
            item['properties']
            properties=item['properties']
            propertieslist.append(properties)
            value = []
            for prop in properties:
                item_value = item['properties'][prop]
                value.append(item_value)
            valuelist.append(value)
        except KeyError: 
            properties = "<null>"
            propertieslist.append(properties)
    return {
            "coordList":coordList,
            "key":propertieslist,
            "value":valuelist,
            }
results = main()
coordList = results["coordList"]
key = results["key"]
value = results["value"]
#colour= results["colour"]
#polylines = results["polylines"]
#brep = results["brep"]
# ---------- end python ----------
python_2 = PythonScript(x=python.key)  # -> simplify(a)
# ---------- python_2: Python ----------
a=x
# ---------- end python_2 ----------
python_3 = PythonScript(x=python.value)  # -> simplify(a); same code as python_2
panel = Panel("""OUTPUTS:

Polyline Curve (P)- Closed Polyline.

Keys (K) - Outputs keys found in properties

Values (V) - Outputs values found in properties""")
panel_2 = Panel(""" 
INPUTS: 

GeoJSON (J) - FeatureCollection containing geoemtry type objects.
*Only accepts easting, northing (N,E) coordinates.
 """)
panel_3 = Panel("For more documentation visit: github.com/madeleinejohanson/Humpback")
lng = ListLength(List=python.coordList)

# ---- group: List of coordinates
data = Data(python.coordList)

# ----
equals = Equality(FirstNumber=lng, SecondNumber=1)  # -> Equality, Inequality
rep_2 = ReplaceText(Text=data, Find=" ", RecursiveReplace=False)
gate = StreamGate(Gate=0)  # -> Target0, Target1
split = TextSplit(Text=rep_2, Separators=",")  # -> simplify(Result)
merge = Merge(
    Data1="GEOJSON TO POLYGON",
    Data2="Converts GeoJSON into Grasshopper geometry.",
    Data3=panel_2,
    Data4=panel,
    Data5=panel_3)
doc = Text(merge)

cull_i = CullIndex(List=split, Indices=0, Wrap=True)
cull_i_2 = CullIndex(List=cull_i, Indices=-1, Wrap=True)

doc_2 = ClusterOutput(doc)
dispatch = Dispatch(List=cull_i_2, DispatchPattern=[False, True])  # -> simplify(ListA), ListB
chars = Characters(Text=dispatch.ListA)  # -> Result, Unicode
mindex = MemberIndex(Set=chars.Result, Member="[")  # -> Index, Count
equals_2 = Equality(FirstNumber=mindex.Count, SecondNumber=2)  # -> simplify(Equality), Inequality
trim = TrimTree(Tree=equals_2.Equality, Depth=1)
ma = MassAddition(Input=trim)  # -> Result, PartialResults
dispatch_2 = Dispatch(List=dispatch.ListA, DispatchPattern=trim)  # -> ListA, ListB
larger = LargerThan(FirstNumber=flatten(ma.Result), SecondNumber=0)  # -> LargerThan, OrEqualTo
viewer = ParamViewer(ma.Result)
index = ItemIndex(List=split, Item=dispatch_2.ListA)  # -> simplify(Index)
clean = CleanTree(RemoveNulls=True, RemoveInvalid=True, RemoveEmpty=True, Tree=index)
short = ShortestList(ListA=Slider(0, range=0..100), ListB=clean, TrimMode=2)  # -> ListA, ListB
dispatch_3 = Dispatch(List=viewer, DispatchPattern=larger.LargerThan)  # -> ListA, ListB
branch = TreeBranch(Tree=split, Path=dispatch_3.ListA, MaintainPaths=True)
branch_2 = TreeBranch(Tree=split, Path=dispatch_3.ListB, MaintainPaths=True)  # -> simplify(Branch)
lng_2 = ListLength(List=branch)
merge_2 = Merge(Data1=short.ListA, Data2=index, Data3=lng_2)
cull_i_3 = CullIndex(List=merge_2, Indices=-1, Wrap=True)
shift = ShiftList(List=merge_2, Shift=1, Wrap=False)
path_mapper = PathMapper(branch_2, source="{A}", target="{A;0}")
subtraction = Subtraction(A=shift, B=cull_i_3)
partition = PartitionList(List=split, Size=subtraction)  # -> simplify(Chunks)
merge_3 = Merge(Data1=path_mapper, Data2=partition)
filter = StreamFilter(Gate=equals.Equality, Stream0=merge_3, Stream1=split)
rep_3 = ReplaceText(Text=filter, Find="[", RecursiveReplace=False)
rep_4 = ReplaceText(Text=rep_3, Find="]", RecursiveReplace=False)
dispatch_4 = Dispatch(List=rep_4, DispatchPattern=[True, False])  # -> ListA, ListB
number_slider = Slider(100000, range=0..100000)
K = Text(simplify(python_2))
V = Data(simplify(python_3))
multiplication = Multiplication(A=dispatch_4.ListB, B=number_slider)
multiplication_2 = Multiplication(A=dispatch_4.ListA, B=number_slider)
pt = ConstructPoint(XCoordinate=multiplication_2, YCoordinate=multiplication, ZCoordinate=0)
lng_3 = ListLength(List=pt)
join = TextJoin(Text=K, Join="█")
join_2 = TextJoin(Text=V, Join="█")
larger_2 = LargerThan(FirstNumber=lng_3, SecondNumber=2)  # -> LargerThan, OrEqualTo
pline = PolyLine(Vertices=pt, Closed=larger_2.LargerThan)
crv = Curve(pline)
P = Curve(simplify(crv))
utrim = UberTrim(data=P, bool=False)
lng_4 = ListLength(List=utrim)
repeat = RepeatData(Data=join, Length=lng_4)
repeat_2 = RepeatData(Data=join_2, Length=lng_4)
split_2 = TextSplit(Text=repeat, Separators="█")  # -> simplify(Result)
split_3 = TextSplit(Text=repeat_2, Separators="█")  # -> simplify(Result)
P_2 = ClusterOutput(P)
K_2 = Text(simplify(split_2))
V_2 = Data(simplify(split_3))
K_3 = ClusterOutput(K_2)
V_3 = ClusterOutput(V_2)

# ==== cluster DeconstructExtrusion11: Deconstructs simple extrusions into polylines, heights, and base heights for later use in ‘Polygon to GeoJSON component’.
brep = ClusterInput()
brep_2 = Brep(simplify(graft(brep)))
cap = CapHoles(Brep=brep_2)
mesh = MeshBrep(
    Brep=cap,
    Settings={GridMaxCount=0, GridMinCount=16, JaggedSeams=False, MaxEdgeLength=0, MinEdgeLength=0.0001, MinTolerance=0, Refine=True, RefineAngle=0, RelativeTolerance=0.65, SimplePlanes=True, Tolerance=0})
mshadow = MeshShadow(Mesh=mesh, Light=Vector(0, 0, -1), Plane=PlaneXY(0, 0, 0))
demesh = DeconstructMesh(Mesh=mesh)  # -> Vertices, Faces, Colours, Normals
pdecon = Deconstruct(Point=demesh.Vertices)  # -> XComponent, YComponent, ZComponent
panel = Panel("Deconstructs simple extrusions into polylines, heights, and base heights for later use in ‘Polygon to GeoJSON component’.")
panel_2 = Panel(""" 
INPUTS: 

Brep (B) - Extruded or capped Breps. Must be extruded in the z axis. """)
panel_3 = Panel("""OUTPUTS:

Polyline (Crv)- Projected base polyline of Brep.

Height (H) - Height of Brep.The distance of extrusion. 

Base Height (BH) - The height of the base of the brep from the ground XY Plane.""")
sort = SortList(Keys=pdecon.ZComponent)  # -> Keys, ValuesA
item = ListItem(List=sort.Keys, Index=0, Wrap=True)  # -> Item1, Item
panel_4 = Panel("For more documentation visit: github.com/madeleinejohanson/Humpback")
subtraction = Subtraction(A=item.Item1, B=item.Item)
bh = Data(simplify(flatten(subtraction)))
bh_2 = Data(simplify(flatten(item.Item)))
Z = UnitZ(Factor=bh_2)
merge = Merge(Data1="DECONSTRUCT EXTRUSION", Data2=panel, Data3=panel_2, Data4=panel_3, Data5=panel_4)
move = Move(Geometry=flatten(mshadow), Motion=Z)  # -> Geometry, Transform
doc = Text(merge)
doc_2 = ClusterOutput(doc)
panel_5 = Panel(doc)

# ---- group: Cluster Output
bh_3 = ClusterOutput(bh)

# ----
bh_4 = ClusterOutput(bh_2)
G = ClusterOutput(move.Geometry)

# ==== cluster PolygonToGeoJSON11: Writes a polygon to a GeoJSON file, where keys and values can be defined.
P = ClusterInput()
P_2 = Curve(P)
cp = ControlPoints(Curve=P_2)  # -> simplify(Points), Weights, Knots
V = ClusterInput()
K = ClusterInput()
V_2 = Data(simplify(V))
points_to_coordinates = PointsToCoordinates(P=cp.Points)
K_2 = Text(simplify(K))
clean = CleanTree(RemoveNulls=True, RemoveInvalid=True, RemoveEmpty=True, Tree=V_2)
viewer = ParamViewer(clean)
flip = FlipMatrix(Data=clean)
graft = GraftTree(Tree=K_2, IncludeEmptyLists=True, IncludeNullItems=True)  # -> simplify(Tree)
viewer_2 = ParamViewer(graft)
short = ShortestList(ListA=viewer_2, ListB=viewer, TrimMode=2)  # -> ListA, ListB
lng = ListLength(List=flatten(short.ListB))
series = Series(Start=0, Step=1, Count=lng)
item = ListItem(List=viewer_2, Index=series, Wrap=False)
flip_2 = FlipMatrix(Data=flip)
branch = TreeBranch(Tree=graft, Path=item, MaintainPaths=True)
clean_2 = CleanTree(RemoveNulls=True, RemoveInvalid=True, RemoveEmpty=True, Tree=branch)
flatten = FlattenTree(Tree=clean_2, Path="{0}")
rep = ReplaceText(Text="\"█\"", Find="█", Replace=flatten, RecursiveReplace=False)  # -> flatten(Result)
series_2 = Series(Start=0, Step=1, Count=lng)
mindex = MemberIndex(Set=rep, Member="\"height\"")  # -> Index, Count
rep_2 = ReplaceText(Text="{ \"type\": \"Polygon\",█}", Find="█", Replace=points_to_coordinates, RecursiveReplace=False)

# ---- group: Polygon
flatten_2 = FlattenTree(Tree=rep_2, Path="{0}")

# ----
mindex_2 = MemberIndex(Set=rep, Member="\"base_height\"")  # -> Index, Count
panel = Panel("Writes a polygon to a GeoJSON file, where keys and values can be defined. ")
panel_2 = Panel("""OUTPUTS:

GeoJSON (J) - Produces a GeoJSON Feature Collection.""")
panel_3 = Panel(""" 
INPUTS: 

Polyline Curve (P) - Polygon or list of polygons to convert to GeoJSON.

Key (K)- Properties used to describe geometry. To specify height, base height and colour, use the following keys: 

height
base_height
colour 

Value (V) - Values of properties. The list should be structured so that the first branch of data is associated with the first key. This allows unique values to be associated with multiple polygons. """)
panel_4 = Panel("For more documentation visit: github.com/madeleinejohanson/Humpback")
rep_3 = ReplaceText(Text="{\"type\":\"Feature\",\"geometry\":█", Find="█", Replace=flatten_2, RecursiveReplace=False)
merge = Merge(Data1="POLYGON TO GEOJSON", Data2=panel, Data3=panel_3, Data6=panel_2, Data7=panel_4)
doc = Text(merge)
doc_2 = ClusterOutput(doc)
panel_5 = Panel(doc)

# ---- group: Keeps lists consistent lengths, repeating the last value for the total amount of keys
null = NullItem(Item=flip)  # -> NullFlags, InvalidFlags, Description
dispatch = Dispatch(List=flip, DispatchPattern=null.NullFlags)  # -> ListA, ListB
nullrep = ReplaceNulls(Items=flip, Replacements="█")  # -> Items, Count
index = ItemIndex(List=dispatch.ListB, Item=dispatch.ListB)
item_2 = ListItem(List=flip, Index=index, Wrap=True)
mindex_3 = MemberIndex(Set=nullrep.Items, Member="█")  # -> Index, Count
flip_3 = FlipMatrix(Data=item_2)
clean_3 = CleanTree(RemoveNulls=True, RemoveInvalid=True, RemoveEmpty=False, Tree=flip_3)
item_3 = ListItem(List=clean_3, Index=0, Wrap=True)  # -> flatten(Item1), Item

# ----
merge_2 = Merge(Data1=flip_3, Data2=flip_2)
clean_4 = CleanTree(RemoveNulls=True, RemoveInvalid=True, RemoveEmpty=False, Tree=merge_2)
item_4 = ListItem(List=clean_4, Index=0, Wrap=True)  # -> flatten(Item1), Item

# ---- group: Keeps lists consistent lengths, repeating the last value for the total amount of keys (continued)
item_5 = ListItem(List=item_4.Item1, Index=mindex_3.Index, Wrap=True)
replace = ReplaceItems(List=nullrep.Items, Item=item_5, Indices=mindex_3.Index, Wrap=False)

# ----
flip_4 = FlipMatrix(Data=replace)
viewer_3 = ParamViewer(flip_4)
item_6 = ListItem(List=viewer_3, Index=series_2, Wrap=True)

# ---- group: Keeps lists consistent lengths, repeating the last value for the total amount of keys (continued)
branch_2 = TreeBranch(Tree=flip_4, Path=item_6, MaintainPaths=True)  # -> simplify(Branch)

# ----
flip_5 = FlipMatrix(Data=branch_2)

# ---- group: height
item_7 = ListItem(List=flip_5, Index=mindex.Index, Wrap=True)

# ---- group: base_height
item_8 = ListItem(List=flip_5, Index=mindex_2.Index, Wrap=True)

# ----
addition = Addition(A=item_7, B=item_8)
replace_2 = ReplaceItems(List=simplify(flip_5), Item=addition, Indices=mindex.Index, Wrap=False)  # -> simplify(List)
clean_5 = CleanTree(RemoveNulls=True, RemoveInvalid=True, RemoveEmpty=True, Tree=replace_2)
key_value = KeyValue(K=clean_2, V=clean_5)
rep_4 = ReplaceText(Text=",\"properties\":█}", Find="█", Replace=key_value, RecursiveReplace=False)

# ---- group: Feature
concat = Concatenate(FragmentA=rep_3, FragmentB=rep_4)  # -> flatten(Result)

# ----
join = TextJoin(Text=concat, Join=",")
panel_6 = Panel(key_value)
rep_5 = ReplaceText(Text="{\"type\":\"FeatureCollection\",\"features\":[█]}", Find="█", Replace=join, RecursiveReplace=False)
J = Text(rep_5)
J_2 = ClusterOutput(J)

# ==== cluster FileWrite: Exports text to file
content = ClusterInput()
file_path = ClusterInput()
activate = ClusterInput()
T = ClusterInput()
content_2 = Data(content)
file_path_2 = Text(file_path)
join = TextJoin(Text=[file_path_2, T], Join="\")
vb = VBScript(path=simplify(join), lines=simplify(content_2), activate=activate)  # -> out, A
# ---------- vb: VB ----------
    If (activate = True)
      
      system.IO.File.WriteAllText(path, lines)
      A = "File written"
    Else
      A = "Not activated"
    End If
# ---------- end vb ----------

# ==== cluster UberTrim: Better version of Trim
data = ClusterInput()
bool = ClusterInput()
data_2 = Data(data)
trim = TrimTree(Tree=data_2, Depth=1)
null = NullItem(Item=trim)  # -> NullFlags, InvalidFlags, Description
dispatch = Dispatch(List=data_2, DispatchPattern=null.NullFlags)  # -> ListA, ListB
bool_2 = Boolean(bool)
trim_2 = TrimTree(Tree=dispatch.ListB, Depth=1)
bool_3 = Boolean(invert(null.NullFlags))
flatten = FlattenTree(Tree=dispatch.ListA, Path="{0}")
merge = Merge(Data1=flatten, Data2=trim_2)
panel = Panel(null.NullFlags)
trim_3 = TrimTree(Tree=data_2, Depth=bool_3)
bool_4 = Boolean(invert(bool_2))
data_3 = Data(trim_3)
dispatch_2 = Dispatch(List=merge, DispatchPattern=bool_4)  # -> ListA, ListB
dispatch_3 = Dispatch(List=data_3, DispatchPattern=bool_2)  # -> ListA, ListB
clean = CleanTree(RemoveNulls=True, RemoveInvalid=True, RemoveEmpty=True, Tree=dispatch_3.ListB)
clean_2 = CleanTree(RemoveNulls=True, RemoveInvalid=True, RemoveEmpty=True, Tree=dispatch_2.ListB)
merge_2 = Merge(Data1=clean, Data2=clean_2)
R = ClusterOutput(merge_2)
panel_2 = Panel(merge_2)

# ==== cluster PointsToCoordinates
P = ClusterInput()
number_slider = Slider(100042, range=0..1000000)
pt2num = PointsToNumbers(Points=graft(P), Mask=4)
number_slider_2 = Slider(1000404, range=0..10000000)
division = Division(A=pt2num, B=Slider(100000, range=0..100000))
expression = Expression(x=division, Expression="format(\"{0}\",x)")
int = Integer(99960)
item = ListItem(List=expression, Index=0, Wrap=True)  # -> Item, Item1, Item2
panel = Panel(pt2num)
num = Number(item.Item2)  # disabled
merge = Merge(Data1=item.Item, Data2=item.Item1, Data3=num)
panel_2 = Panel(division)
wrapper = Wrapper(wrap="[", content=merge, join=",")  # -> simplify(wrapped)
utrim = UberTrim(data=wrapper, bool=Toggle(True))
wrapper_2 = Wrapper(wrap="[", content=utrim, join=",")
rep = ReplaceText(Text="\"coordinates\": [█]", Find="█", Replace=wrapper_2, RecursiveReplace=False)  # -> simplify(Result)
R = ClusterOutput(rep)

# ==== cluster KeyValue
K = ClusterInput()
V = ClusterInput()
K_2 = Text(simplify(K))
V_2 = Data(simplify(V))

# ---- group: HUMPBACK 1.1 Treats numbers as numbers instead of strings
int = Integer(V_2)
null = NullItem(Item=int)  # -> NullFlags, InvalidFlags, Description
panel = Panel("""█
"█"
""")
item = ListItem(List=panel, Index=null.NullFlags, Wrap=True)
rep = ReplaceText(Text=item, Find="█", Replace=V_2, RecursiveReplace=False)

# ----
panel_2 = Panel(K_2)
rep_2 = ReplaceText(Text="\"█\"", Find="█", Replace=K_2, RecursiveReplace=False)  # -> simplify(Result)
panel_3 = Panel("\"█\"")  # disabled
panel_4 = Panel("█")  # disabled
rep_3 = ReplaceText(Text=panel_3, Find=panel_4, Replace=V_2, RecursiveReplace=False)  # disabled
flip = FlipMatrix(Data=rep)  # -> simplify(Data)
lng = ListLength(List=flatten(rep_2))
viewer = ParamViewer(flip)
series = Series(Start=0, Step=1, Count=lng)
item_2 = ListItem(List=viewer, Index=series, Wrap=True)
branch = TreeBranch(Tree=simplify(flip), Path=simplify(item_2), MaintainPaths=True)
long = LongestList(ListA=rep_2, ListB=branch, PaddingMode=2)  # -> ListA, ListB
merge = Merge(Data1=graft(long.ListA), Data2=graft(long.ListB))
join = TextJoin(Text=merge, Join=":")
trim = TrimTree(Tree=join, Depth=1)
flip_2 = FlipMatrix(Data=trim)
join_2 = TextJoin(Text=flip_2, Join=",")
rep_4 = ReplaceText(Text="{█}", Find="█", Replace=join_2, RecursiveReplace=False)  # -> flatten(Result)
J = Text(rep_4)
J_2 = ClusterOutput(J)

# ==== cluster Wrapper: Wraps data with a wrapping character
join = ClusterInput()  # Join character
content = ClusterInput()  # Content to be wrapped
wrap = ClusterInput()  # Wrap character or XML tag
txt = Text(join)
null = NullItem(Item=txt)  # -> NullFlags, InvalidFlags, Description
data = Data(content)
tmatch = MatchText(Text=wrap, RegEx="<*.>", Case=True)
bool = Boolean(null.NullFlags)
dispatch = Dispatch(List=data, DispatchPattern=bool)  # -> ListA, ListB
item = ListItem(List=wrap, Index=0, Wrap=True)
split = TextSplit(Text=item, Separators=" ")
join_2 = TextJoin(Text=dispatch.ListB, Join=txt)
panel = Panel("""{
[
(
"
'""")
panel_2 = Panel("""{█}
[█]
(█)
"█"
'█'""")
item_2 = ListItem(List=split, Index=0, Wrap=True)
weave = Weave(Pattern=bool, Stream0=join_2, Stream1=dispatch.ListA, NullGaps=False)
data_2 = Data(wrap)
replace = ReplaceMembers(Set=data_2, Find=panel, Replace=panel_2)
rep = ReplaceText(Text=item_2, Find="<", Replace="</", RecursiveReplace=False)
expression = Expression(x=item, y=rep, Expression="Format(\"{0}█{1}>\", x, y)")
rep_2 = ReplaceText(Text=expression, Find=">>", Replace=">", RecursiveReplace=False)
weave_2 = Weave(Pattern=tmatch, Stream0=replace, Stream1=rep_2, NullGaps=False)
rep_3 = ReplaceText(Text=weave_2, Find="█", Replace=weave, RecursiveReplace=False)
data_3 = Data(rep_3)
wrapped = ClusterOutput(data_3)  # Wrapped Output
